# Dynamo graph protected_template.dyn "(Without select MText)" (Dynamo 3.3.1.7726)

# group: Extracting Data from MText (all MText)
string = StringInput("""# Input: grouped list of dictionaries (from previous script)
grouped_data = IN[0]

# Get first Name from each group
first_names = [group["Name"][0] for group in grouped_data if group["Name"]]

# Output: list of first MH names (used for naming)
OUT = first_names
""")
string_2 = StringInput("""import re
from math import hypot
from collections import defaultdict

# Input: list of MText elements from Dynamo
mtexts = IN[0]
tolerance = 20.0  # meters: max distance between separate MText pieces of the same MH

# Step 1: Extract text and location
mtext_data = []
for m in mtexts:
    try:
        pt = m.Location
        mtext_data.append({
            "text": m.Contents,
            "X": pt.X,
            "Y": pt.Y
        })
    except:
        continue

# Step 2: Group MText entries that are close together (belong to one manhole)
groups = []
while mtext_data:
    base = mtext_data.pop(0)
    group = [base]
    remaining = []

    for other in mtext_data:
        dist = hypot(base["X"] - other["X"], base["Y"] - other["Y"])
        if dist <= tolerance:
            group.append(other)
        else:
            remaining.append(other)
    groups.append(group)
    mtext_data = remaining

# Step 3: Merge the grouped text entries
combined_texts = []
for g in groups:
    merged = "\\P".join([item["text"] for item in g])
    combined_texts.append(merged)

# Step 4: Clean and parse MText contents
def clean_mtext(raw):
    raw = re.sub(r'{\\.*?;', '', raw)
    raw = raw.replace('}', '')
    return raw

def parse_mtext(text):
    text = clean_mtext(text)
    lines = text.replace('\\P', '\n').split('\n')
    data = {"Name": "", "E": 0.0, "N": 0.0, "CL": 0.0, "IL": 0.0}

    for line in lines:
        line = line.strip().lower()
        if any(key in line for key in ["cl", "gl", "fl"]):
            matches = re.findall(r"[-+]?\d*\.\d+|\d+", line)
            if matches:
                data["CL"] = float(matches[0])
        elif "il" in line:
            matches = re.findall(r"[-+]?\d*\.\d+|\d+", line)
            if matches:
                data["IL"] = float(matches[0])
        elif line.startswith("e") or "e:" in line:
            matches = re.findall(r"[-+]?\d*\.\d+|\d+", line)
            if matches:
                data["E"] = float(matches[0])
        elif line.startswith("n") or "n:" in line:
            matches = re.findall(r"[-+]?\d*\.\d+|\d+", line)
            if matches:
                data["N"] = float(matches[0])
        elif "mh" in line:
            data["Name"] = line.upper()
    return data

parsed = [parse_mtext(txt) for txt in combined_texts]

# Step 5: Group by base name (e.g., MH-1)
def get_base_name(name):
    parts = name.split('-')
    return '-'.join(parts[:-1]) if len(parts) > 1 else name

grouped = defaultdict(list)
for item in parsed:
    name = item.get("Name")
    if name:
        base = get_base_name(name)
        grouped[base].append(item)

# Step 6: Smart sort inside each group by padded name
def pad_name(name):
    parts = name.split('-')
    padded = [parts[0]]
    for part in parts[1:]:
        padded.append(part.zfill(3) if part.isdigit() else part)
    return '-'.join(padded)

all_groups = []
for base_name in sorted(grouped.keys()):
    group_items = grouped[base_name]
    group_items.sort(key=lambda x: pad_name(x['Name']))

    names = [i['Name'] for i in group_items]
    easting = [i['E'] for i in group_items]
    northing = [i['N'] for i in group_items]
    cl = [i['CL'] for i in group_items]
    il = [i['IL'] for i in group_items]

    all_groups.append({
        "Name": names,
        "E": easting,
        "N": northing,
        "CL": cl,
        "IL": il
    })

# ✅ Final output
OUT = all_groups
""")
choose_object_type = AcObjectTypes("MText")
all_objects_of_type = AcObjectsOfType(type=choose_object_type)
python_script_from_string = PythonStringNode(script=string_2, IN[0]=all_objects_of_type)  # CPython3
get_network_1st_name_of_mh = PythonStringNode(script=string, IN[0]=python_script_from_string)  # CPython3
code_block = CodeBlock { "MH"; "LINE"; }
replace = String.Replace(string=get_network_1st_name_of_mh, searchFor=code_block.out0, replaceWith=code_block.out1)
values = DesignScript.Builtin.Dictionary.Values(dictionary=python_script_from_string)
transpose = List.Transpose(lists=values)
uniqueItems = List.UniqueItems(list=transpose)
code_block_2 = CodeBlock { 0; 1; 2; 3; 4; }
easting = List.GetItemAtIndex(list=uniqueItems, index=code_block_2.out3)
northing = List.GetItemAtIndex(list=uniqueItems, index=code_block_2.out4)
rim_elev = List.GetItemAtIndex(list=uniqueItems, index=code_block_2.out1)
byCoordinates = Point.ByCoordinates(x=easting, y=northing, z=rim_elev)
current = Autodesk.AutoCAD.DynamoNodes.Document.Current()
description = List.GetItemAtIndex(list=uniqueItems, index=code_block_2.out0)
byGeometry = Autodesk.Civil.DynamoNodes.CogoPoint.ByGeometry(point=byCoordinates, document=current, name=description, rawDescription=description)
regen = Autodesk.AutoCAD.DynamoNodes.Document.Regen(document=current)
invert_elev = List.GetItemAtIndex(list=uniqueItems, index=code_block_2.out2)
flatten = List.Flatten(list=byGeometry)
string_3 = StringInput("All MH")
byCogoPoints = Autodesk.Civil.DynamoNodes.CogoPointGroup.ByCogoPoints(cogoPoints=flatten, cogoPointGroupName=string_3, document=current, description=string_3)

# group: Ref. Surface
name = Autodesk.Civil.DynamoNodes.CogoPointGroup.Name(cogoPointGroup=byCogoPoints)
byCogoPointGroup = Autodesk.Civil.DynamoNodes.TinSurface.ByCogoPointGroup(cogoPointGroupName=name, surfaceName=string_3, document=current)

# group: Create Structures-( All MText)
byName = Autodesk.Civil.DynamoNodes.PipeNetwork.ByName(name=replace)
n01_default_part_list_name = StringInput("Sanitary Sewer")  # "01-Default Part List Name"; graph input
setPartsList = Autodesk.Civil.DynamoNodes.PipeNetwork.SetPartsList(pipeNetwork=byName, partsListName=n01_default_part_list_name)
n02_default_part_family_name_mh = StringInput("Concentric Cylindrical Structure SI")  # "02-Default Part Family Name-(MH)"; graph input
n03_default_part_size_name_mh = StringInput("Concentric Structure 1,500 dia 530 frame 900 cone")  # "03-Default Part Size Name-(MH)"; graph input
structure_bypoint_dynamo_defult = Autodesk.Civil.DynamoNodes.Structure.ByPoint(pipeNetwork=byName, partFamilyName=n02_default_part_family_name_mh, partSizeName=n03_default_part_size_name_mh, insertionPoint=byCoordinates)
setReferenceSurface = Autodesk.Civil.DynamoNodes.PipeNetwork.SetReferenceSurface(pipeNetwork=byName, referenceSurface=byCogoPointGroup)

# group: Change Structure Name and Description-( All MText)
string_4 = StringInput("""# Inputs:
# IN[0] = structures (list of created structures)
# IN[1] = cogoNames (list of Cogo Point names)

structures = IN[0]
cogoNames = IN[1]

# Flatten if needed
def flatten(x):
    if isinstance(x, list):
        out = []
        for i in x:
            out.extend(flatten(i))
        return out
    else:
        return [x]

structures = flatten(structures)
cogoNames = flatten(cogoNames)

# Match names by index
result_names = []

for i in range(len(structures)):
    if i < len(cogoNames):
        result_names.append(cogoNames[i])
    else:
        result_names.append("Structure-" + str(i + 1))  # fallback

OUT = structures, result_names
""")
name_2 = Autodesk.Civil.DynamoNodes.CogoPoint.Name(cogoPoint=byGeometry)
python_script_from_string_2 = PythonStringNode(script=string_4, IN[0]=structure_bypoint_dynamo_defult, IN[1]=name_2)  # CPython3
code_block_3 = CodeBlock { 0; }
getItemAtIndex = List.GetItemAtIndex(list=python_script_from_string_2, index=code_block_3)
code_block_4 = CodeBlock { 1; }
getItemAtIndex_2 = List.GetItemAtIndex(list=python_script_from_string_2, index=code_block_4)
setName = Autodesk.Civil.DynamoNodes.CivilObject.SetName(civilObject=getItemAtIndex, name=getItemAtIndex_2)
setDescription = Autodesk.Civil.DynamoNodes.CivilObject.SetDescription(civilObject=structure_bypoint_dynamo_defult, description=replace)

# group: Create PIPES-( All MText)
string_5 = StringInput("""# Inputs:
# IN[0] = networks (list of PipeNetwork objects)
# IN[1] = structure_counts (list of int)

networks = IN[0]
structure_counts = IN[1]

# Filter networks where structure count > 1
filtered_networks = [net for net, count in zip(networks, structure_counts) if count > 1]

OUT = filtered_networks
""")
string_6 = StringInput("""# Python Node solution
input = IN[0]  # Your main list
counts = []

for item in input:
    if isinstance(item, list):
        counts.append(len(item))
    else:
        # Count as 1 if it's a single structure (not in a list)
        counts.append(1 if item is not None else 0)

OUT = counts""")
python_script_from_string_3 = PythonStringNode(script=string_6, IN[0]=setDescription)  # CPython3
multi_pipenetworks = PythonStringNode(script=string_5, IN[0]=python_script_from_string_3)  # CPython3
n04_part_family_name_pipe = StringInput("PVC Pipe SI")  # "04-Part Family Name-(Pipe)"; graph input
n05_part_size_name_pipe = StringInput("600 mm PVC Pipe")  # "05-Part Size Name-(Pipe)"; graph input
string_7 = StringInput("""# Input: Your nested list of structure groups
structure_groups = IN[0]

# Initialize output lists
start_structures = []
end_structures = []

for group in structure_groups:
    # Handle start structures (all except last)
    if len(group) > 1:
        start_structures.append(group[:-1])
    else:
        start_structures.append([])
    
    # Handle end structures (all except first)
    if len(group) > 1:
        end_structures.append(group[1:])
    else:
        end_structures.append([])

# Assign outputs - CRITICAL FOR DYNAMO
OUT = start_structures, end_structures""")
string_8 = StringInput("""# Inputs:
# IN[0] = networks (list of 34 PipeNetwork objects)
# IN[1] = structure_groups (list of 34 lists of structures)
# IN[2] = structure_counts (list of 34 ints)

networks = IN[0]
structure_groups = IN[1]
structure_counts = IN[2]

# Step 1: Find indexes where structure count > 1
valid_indexes = [i for i, count in enumerate(structure_counts) if count > 1]

# Step 2: Filter networks and structure_groups
filtered_networks = [networks[i] for i in valid_indexes]
filtered_structure_groups = [structure_groups[i] for i in valid_indexes]

# Output both
OUT = filtered_structure_groups
""")
multi_structures = PythonStringNode(script=string_8, IN[0]=byName, IN[1]=setDescription, IN[2]=python_script_from_string_3)  # CPython3
python_script_from_string_4 = PythonStringNode(script=string_7, IN[0]=multi_structures)  # CPython3
code_block_5 = CodeBlock { 0; 1; }
end_structures = List.GetItemAtIndex(list=python_script_from_string_4, index=code_block_5.out1)
start_structures = List.GetItemAtIndex(list=python_script_from_string_4, index=code_block_5.out0)
sumpElevation = Autodesk.Civil.DynamoNodes.Structure.SumpElevation(structure=end_structures)
sumpElevation_2 = Autodesk.Civil.DynamoNodes.Structure.SumpElevation(structure=start_structures)
pipe_bystructures_multi = Autodesk.Civil.DynamoNodes.Pipe.ByStructures(pipeNetwork=multi_pipenetworks, partFamilyName=n04_part_family_name_pipe, partSizeName=n05_part_size_name_pipe, startStructure=end_structures, endStructure=start_structures, startInvert=sumpElevation, endInvert=sumpElevation_2)
current_2 = Autodesk.AutoCAD.DynamoNodes.Document.Current()
regen_2 = Autodesk.AutoCAD.DynamoNodes.Document.Regen(document=current_2)
string_9 = StringInput("""# Inputs:
# IN[0] = networks (list of PipeNetwork objects)
# IN[1] = structure_counts (list of int)

networks = IN[0]
structure_counts = IN[1]

# Filter networks where structure count > 1
filtered_networks = [net for net, count in zip(networks, structure_counts) if count < 2]

OUT = filtered_networks
""")
single_pipe_networks = PythonStringNode(script=string_9, IN[0]=byName, IN[1]=python_script_from_string_3)  # CPython3
string_10 = StringInput("import clr\nclr.AddReference('ProtoGeometry')\nfrom Autodesk.DesignScript.Geometry import *\n\n# Inputs\nstructure_groups = IN[0]  # List of lists of structures\nstructure_counts = IN[1]  # List of counts for each group\n\ndef is_valid_connection(child, parent):\n    \"\"\"Strict validation of naming hierarchy\"\"\"\n    child_parts = child.Name.split('-')\n    parent_parts = parent.Name.split('-')\n    \n    # Parent must have exactly one fewer segments\n    if len(parent_parts) != len(child_parts) - 1:\n        return False\n    \n    # All parent segments must match child segments exactly\n    for i in range(len(parent_parts)):\n        if parent_parts[i] != child_parts[i]:\n            return False\n    \n    return True\n\n# Main processing\ntry:\n    # 1. Prepare all structures\n    all_structures = []\n    single_structures = []\n    \n    for i, group in enumerate(structure_groups):\n        if not hasattr(group, '__iter__'):\n            group = [group]\n        all_structures.extend(group)\n        if structure_counts[i] == 1:\n            single_structures.append(group[0])\n    \n    # 2. Find valid parents for each single structure\n    connections = []\n    for child in single_structures:\n        child_parts = child.Name.split('-')\n        if len(child_parts) < 2:\n            continue  # Cannot have parent if only 1 segment\n            \n        parent_pattern = '-'.join(child_parts[:-1])  # Remove last segment\n        \n        # Search for exact parent match\n        for potential_parent in all_structures:\n            if (potential_parent.Name == parent_pattern and \n                is_valid_connection(child, potential_parent)):\n                connections.append({\n                    'child': child,\n                    'parent': potential_parent,\n                    'relationship': f\"{child.Name} → {potential_parent.Name}\"\n                })\n                break\n    \n    OUT = connections if connections else \"No valid connections found\"\n\nexcept Exception as e:\n    OUT = f\"Error: {str(e)}\"")
group_of_child_and_parent = PythonStringNode(script=string_10, IN[0]=setDescription, IN[1]=python_script_from_string_3)  # "Group of Child and Parent Structures"; CPython3
code_block_6 = CodeBlock { "child"; }
valueAtKey = DesignScript.Builtin.Dictionary.ValueAtKey(dictionary=group_of_child_and_parent, key=code_block_6)
count = List.Count(list=single_pipe_networks)
code_block_7 = CodeBlock(count=count) { 0; count; 1; }
sequence = Sequence(start=code_block_7.out0, amount=code_block_7.count, step=code_block_7.out2)
start_structures_2 = List.GetItemAtIndex(list=valueAtKey, index=sequence)
code_block_8 = CodeBlock { "parent"; }
valueAtKey_2 = DesignScript.Builtin.Dictionary.ValueAtKey(dictionary=group_of_child_and_parent, key=code_block_8)
end_structures_2 = List.GetItemAtIndex(list=valueAtKey_2, index=sequence)
sumpElevation_3 = Autodesk.Civil.DynamoNodes.Structure.SumpElevation(structure=start_structures_2)
sumpElevation_4 = Autodesk.Civil.DynamoNodes.Structure.SumpElevation(structure=end_structures_2)
pipe_bystructures_single = Autodesk.Civil.DynamoNodes.Pipe.ByStructures(pipeNetwork=single_pipe_networks, partFamilyName=n04_part_family_name_pipe, partSizeName=n05_part_size_name_pipe, startStructure=start_structures_2, endStructure=end_structures_2, startInvert=sumpElevation_3, endInvert=sumpElevation_4)
string_11 = StringInput("""# Inputs:
# IN[0] = networks (list of 34 PipeNetwork objects)
# IN[1] = structure_groups (list of 34 lists of structures)
# IN[2] = structure_counts (list of 34 ints)

networks = IN[0]
structure_groups = IN[1]
structure_counts = IN[2]

# Step 1: Find indexes where structure count > 1
valid_indexes = [i for i, count in enumerate(structure_counts) if count < 2]

# Step 2: Filter networks and structure_groups
filtered_networks = [networks[i] for i in valid_indexes]
filtered_structure_groups = [structure_groups[i] for i in valid_indexes]

# Output both
OUT = filtered_structure_groups
""")
single_structures = PythonStringNode(script=string_11, IN[0]=byName, IN[1]=setDescription, IN[2]=python_script_from_string_3)  # CPython3

# group: Set Name of Pipes (Based on MH names)
startStructure = Autodesk.Civil.DynamoNodes.Pipe.StartStructure(pipe=pipe_bystructures_multi)
name_3 = Autodesk.Civil.DynamoNodes.CivilObject.Name(civilObject=startStructure)
endStructure = Autodesk.Civil.DynamoNodes.Pipe.EndStructure(pipe=pipe_bystructures_multi)
name_4 = Autodesk.Civil.DynamoNodes.CivilObject.Name(civilObject=endStructure)
code_block_9 = CodeBlock(first=name_3, second=name_4) { first+" _ "+second; }
setName_2 = Autodesk.Civil.DynamoNodes.CivilObject.SetName(civilObject=pipe_bystructures_multi, name=code_block_9)
choose_pipe_flow_direction = EnumPipeFlowDirectionMethod("By Slope", EnumDictionary={BySlope: "By Slope", StartToEnd: "Start To End", Bidirectional: "Bi-directional", EndToStart: "End To Start"})  # "Choose Pipe Flow Direction Method"
setFlowDirectionMethod = Autodesk.Civil.DynamoNodes.Pipe.SetFlowDirectionMethod(pipe=setName_2, flowDirectionMethod=choose_pipe_flow_direction)

# group: Enter Defult Pipe Diameter
n06_default_diameter = StringInput("600")  # "06-Default Diameter"; graph input
toNumber = String.ToNumber(string=n06_default_diameter)
resize = Autodesk.Civil.DynamoNodes.Pipe.Resize(pipe=pipe_bystructures_multi, innerDiameterOrWidth=toNumber)

# group: Set Name of Pipes (Based on MH names)
startStructure_2 = Autodesk.Civil.DynamoNodes.Pipe.StartStructure(pipe=pipe_bystructures_single)
name_5 = Autodesk.Civil.DynamoNodes.CivilObject.Name(civilObject=startStructure_2)
endStructure_2 = Autodesk.Civil.DynamoNodes.Pipe.EndStructure(pipe=pipe_bystructures_single)
name_6 = Autodesk.Civil.DynamoNodes.CivilObject.Name(civilObject=endStructure_2)
code_block_10 = CodeBlock(first=name_5, second=name_6) { first+" _ "+second; }
setName_3 = Autodesk.Civil.DynamoNodes.CivilObject.SetName(civilObject=pipe_bystructures_single, name=code_block_10)
choose_pipe_flow_direction_2 = EnumPipeFlowDirectionMethod("By Slope", EnumDictionary={BySlope: "By Slope", StartToEnd: "Start To End", Bidirectional: "Bi-directional", EndToStart: "End To Start"})  # "Choose Pipe Flow Direction Method"
setFlowDirectionMethod_2 = Autodesk.Civil.DynamoNodes.Pipe.SetFlowDirectionMethod(pipe=setName_3, flowDirectionMethod=choose_pipe_flow_direction_2)

# group: Sump Elevation of MH-( All MText)
choose_sump_control_method = EnumControlSumpBy("By Elevation", EnumDictionary={ByElevation: "By Elevation", ByDepth: "By Depth"})
setSumpControlMethod = Autodesk.Civil.DynamoNodes.Structure.SetSumpControlMethod(structure=setDescription, sumpControlMethod=choose_sump_control_method)
code_block_11 = CodeBlock { 0; }
code_block_12 = CodeBlock(Sump_elev=invert_elev, DEPTH=code_block_11) { Sump_elev-DEPTH; }
code_block_13 = CodeBlock { 3; }
round = Math.Round(number=code_block_12, digits=code_block_13)
setSumpElevation = Autodesk.Civil.DynamoNodes.Structure.SetSumpElevation(structure=setSumpControlMethod, sumpElevation=round)
endStructure_3 = Autodesk.Civil.DynamoNodes.Pipe.EndStructure(pipe=pipe_bystructures_multi)
sumpElevation_5 = Autodesk.Civil.DynamoNodes.Structure.SumpElevation(structure=endStructure_3)
setEndInvert = Autodesk.Civil.DynamoNodes.Pipe.SetEndInvert(pipe=pipe_bystructures_multi, endInvert=sumpElevation_5)
startStructure_3 = Autodesk.Civil.DynamoNodes.Pipe.StartStructure(pipe=pipe_bystructures_multi)
sumpElevation_6 = Autodesk.Civil.DynamoNodes.Structure.SumpElevation(structure=startStructure_3)
setStartInvert = Autodesk.Civil.DynamoNodes.Pipe.SetStartInvert(pipe=pipe_bystructures_multi, startInvert=sumpElevation_6)
startStructure_4 = Autodesk.Civil.DynamoNodes.Pipe.StartStructure(pipe=pipe_bystructures_single)
sumpElevation_7 = Autodesk.Civil.DynamoNodes.Structure.SumpElevation(structure=startStructure_4)
setStartInvert_2 = Autodesk.Civil.DynamoNodes.Pipe.SetStartInvert(pipe=pipe_bystructures_single, startInvert=sumpElevation_7)
endStructure_4 = Autodesk.Civil.DynamoNodes.Pipe.EndStructure(pipe=pipe_bystructures_single)
sumpElevation_8 = Autodesk.Civil.DynamoNodes.Structure.SumpElevation(structure=endStructure_4)
setEndInvert_2 = Autodesk.Civil.DynamoNodes.Pipe.SetEndInvert(pipe=pipe_bystructures_single, endInvert=sumpElevation_8)

# group: Create Alignments - for Multi Networks
code_block_14 = CodeBlock { 1; }
gt = python_script_from_string_3 > code_block_14
filterByBoolMask = List.FilterByBoolMask(list=byCoordinates, mask=gt)
name_7 = Autodesk.Civil.DynamoNodes.CivilObject.Name(civilObject=multi_pipenetworks)
code_block_15 = CodeBlock { 0; }
byPoints = Autodesk.Civil.DynamoNodes.Alignment.ByPoints(points=filterByBoolMask.in, name=name_7, startStation=code_block_15)

setReferenceAlignment = Autodesk.Civil.DynamoNodes.Part.SetReferenceAlignment(part=multi_structures, referenceAlignment=byPoints)
referenceSurface = Autodesk.Civil.DynamoNodes.Part.ReferenceSurface(part=setReferenceAlignment)
setReferenceAlignment_2 = Autodesk.Civil.DynamoNodes.PipeNetwork.SetReferenceAlignment(pipeNetwork=multi_pipenetworks, referenceAlignment=byPoints)
setReferenceAlignment_3 = Autodesk.Civil.DynamoNodes.Part.SetReferenceAlignment(part=pipe_bystructures_multi, referenceAlignment=byPoints)
referenceSurface_2 = Autodesk.Civil.DynamoNodes.Part.ReferenceSurface(part=setReferenceAlignment_3)
setReferenceSurface_2 = Autodesk.Civil.DynamoNodes.PipeNetwork.SetReferenceSurface(pipeNetwork=setReferenceAlignment_2, referenceSurface=referenceSurface_2)
setSumpElevation_2 = Autodesk.Civil.DynamoNodes.Structure.SetSumpElevation(structure=structure_bypoint_dynamo_defult, sumpElevation=invert_elev)
sumpElevation_9 = Autodesk.Civil.DynamoNodes.Structure.SumpElevation(structure=setSumpElevation_2)
code_block_16 = CodeBlock(Easting=easting, Northing=northing) { maxNum = List.MaximumItem(Easting); minNum = List.MinimumItem(Northing); }
sort = List.Sort(list=code_block_16.maxNum)
max_east = List.LastItem(list=sort)
sort_2 = List.Sort(list=code_block_16.minNum)

# group: Create Alignments - for Single Networks
startPoint = Autodesk.Civil.DynamoNodes.Pipe.StartPoint(pipe=pipe_bystructures_single)
name_8 = Autodesk.Civil.DynamoNodes.CivilObject.Name(civilObject=single_pipe_networks)
count_2 = List.Count(list=name_8)
code_block_17 = CodeBlock(count=count_2) { 0; count; 1; }
sequence_2 = Sequence(start=code_block_17.out0, amount=code_block_17.count, step=code_block_17.out2)
getItemAtIndex_3 = List.GetItemAtIndex(list=startPoint, index=sequence_2)
endPoint = Autodesk.Civil.DynamoNodes.Pipe.EndPoint(pipe=pipe_bystructures_single)
getItemAtIndex_4 = List.GetItemAtIndex(list=endPoint, index=sequence_2)
list_create = List.Create(item0=getItemAtIndex_3, item1=getItemAtIndex_4)
transpose_2 = List.Transpose(lists=list_create)
code_block_18 = CodeBlock { 0; }
byPoints_2 = Autodesk.Civil.DynamoNodes.Alignment.ByPoints(points=transpose_2, name=name_8, startStation=code_block_18)

setReferenceAlignment_4 = Autodesk.Civil.DynamoNodes.Part.SetReferenceAlignment(part=single_structures, referenceAlignment=byPoints_2)
setReferenceAlignment_5 = Autodesk.Civil.DynamoNodes.Part.SetReferenceAlignment(part=pipe_bystructures_single, referenceAlignment=byPoints_2)
referenceSurface_3 = Autodesk.Civil.DynamoNodes.Part.ReferenceSurface(part=setReferenceAlignment_4)
setReferenceAlignment_6 = Autodesk.Civil.DynamoNodes.PipeNetwork.SetReferenceAlignment(pipeNetwork=single_pipe_networks, referenceAlignment=byPoints_2)
referenceSurface_4 = Autodesk.Civil.DynamoNodes.Part.ReferenceSurface(part=setReferenceAlignment_5)
setReferenceSurface_3 = Autodesk.Civil.DynamoNodes.PipeNetwork.SetReferenceSurface(pipeNetwork=setReferenceAlignment_6, referenceSurface=referenceSurface_4)
name_9 = Autodesk.Civil.DynamoNodes.PipeNetwork.Name(pipeNetwork=setReferenceSurface_3)
name_10 = Autodesk.Civil.DynamoNodes.PipeNetwork.Name(pipeNetwork=setReferenceAlignment_2)

# group: Create Profile and Profile View - for Multi Networks
flatten_2 = List.Flatten(list=byPoints)
original_east = CodeBlock(ProPoint=max_east) { ProPoint+5000; }
min_north = List.FirstItem(list=sort_2)
count_3 = List.Count(list=byPoints)
code_block_19 = CodeBlock { -1000; 0; }
sequence_3 = Sequence(start=min_north, amount=count_3, step=code_block_19.out0)
byCoordinates_2 = Point.ByCoordinates(x=original_east, y=sequence_3, z=code_block_19.out1)
code_block_20 = CodeBlock(x=byPoints) { x != null; }
filterByBoolMask_2 = List.FilterByBoolMask(list=byPoints, mask=code_block_20)
list_create_2 = List.Create()  # unwired: item0
map = List.Map(list=filterByBoolMask_2.in, function=list_create_2)
referenceSurface_5 = Autodesk.Civil.DynamoNodes.PipeNetwork.ReferenceSurface(pipeNetwork=setReferenceAlignment_2)
uniqueItems_2 = List.UniqueItems(list=name_10)
code_block_21 = CodeBlock(network=uniqueItems_2) { "PRO - "+network; }
bySurface = Autodesk.Civil.DynamoNodes.Profile.BySurface(alignment=map, surface=referenceSurface_5, name=code_block_21)
dataSource = Autodesk.Civil.DynamoNodes.Profile.DataSource(profile=bySurface)
alignment = Autodesk.Civil.DynamoNodes.Profile.Alignment(profile=bySurface)

flatten_3 = List.Flatten(list=byCoordinates_2)

# group (continued): Create Profile and Profile View - for Multi Networks
byAlignment = Autodesk.Civil.DynamoNodes.ProfileView.ByAlignment(alignment=flatten_2, insertionPoint=flatten_3, lacing=Shortest)
addToProfileView = Autodesk.Civil.DynamoNodes.Part.AddToProfileView(part=setReferenceAlignment_3, profileView=byAlignment)
addToProfileView_2 = Autodesk.Civil.DynamoNodes.Part.AddToProfileView(part=setReferenceAlignment, profileView=byAlignment)

# group: Create Profile and Profile View - for Single Networks
flatten_4 = List.Flatten(list=byPoints_2)
code_block_22 = CodeBlock(Y=min_north, new_Pt=count_3, spacing=code_block_19.out0) { Y+(new_Pt*spacing)+spacing; spacing; 0; }
count_4 = List.Count(list=byPoints_2)
sequence_4 = Sequence(start=code_block_22.out0, amount=count_4, step=code_block_22.spacing)
byCoordinates_3 = Point.ByCoordinates(x=original_east, y=sequence_4, z=code_block_22.out2)
byAlignment_2 = Autodesk.Civil.DynamoNodes.ProfileView.ByAlignment(alignment=flatten_4, insertionPoint=byCoordinates_3)
addToProfileView_3 = Autodesk.Civil.DynamoNodes.Part.AddToProfileView(part=setReferenceAlignment_4, profileView=byAlignment_2)
addToProfileView_4 = Autodesk.Civil.DynamoNodes.Part.AddToProfileView(part=setReferenceAlignment_5, profileView=byAlignment_2)
bySurface_2 = Autodesk.Civil.DynamoNodes.Profile.BySurface(alignment=byPoints_2, surface=referenceSurface_3, name=name_9)
dataSource_2 = Autodesk.Civil.DynamoNodes.Profile.DataSource(profile=bySurface_2)

# group: Resize Pipe Diameter
list_create_3 = List.Create(item0=pipe_bystructures_multi, item1=pipe_bystructures_single)
flatten_5 = List.Flatten(list=list_create_3)
choose_object_type_2 = AcObjectTypes("MText")
all_objects_of_type_2 = AcObjectsOfType(type=choose_object_type_2)
dia_coord_of_mtext = Python(IN[0]=all_objects_of_type_2)  # CPython3
# ---------- dia_coord_of_mtext.python (32 lines) ----------
import re

mtexts = IN[0]

def clean_mtext(raw):
    raw = re.sub(r'{\\.*?;', '', raw)
    raw = raw.replace('}', '')
    return raw

def extract_dia(text):
    text = clean_mtext(text)
    lines = text.replace('\\P', '\n').split('\n')
    for line in lines:
        line = line.strip()
        if "dia" in line.lower() or "ø" in line:
            matches = re.findall(r"[-+]?\d*\.\d+|\d+", line)
            if matches:
                return float(matches[0])
    return None

results = []

for mtext in mtexts:
    dia = extract_dia(mtext.Contents)
    if dia is not None:
        try:
            pt = mtext.Location  # Use Location instead of Geometry
            results.append({"Dia": dia, "E": pt.X, "N": pt.Y})
        except:
            results.append({"Dia": dia, "E": None, "N": None})

OUT = results
# ----------------------------------------
python_script = Python(IN[0]=flatten_5, IN[1]=dia_coord_of_mtext)  # CPython3
# ---------- python_script.python (35 lines) ----------
import math

pipes = IN[0]        # List of pipes
dia_points = IN[1]   # List of dicts: {"Dia": 200.0, "E": ..., "N": ...}
threshold = 20.0      # distance tolerance

def get_midpoint(pipe):
    s = pipe.StartPoint
    e = pipe.EndPoint
    return ((s.X + e.X)/2, (s.Y + e.Y)/2)

def distance(p1, p2):
    return math.hypot(p1[0] - p2[0], p1[1] - p2[1])

matched_pipes = []
matched_diams = []
messages = []

for pipe in pipes:
    mp = get_midpoint(pipe)
    matched = False

    for dia_data in dia_points:
        dp = (dia_data["E"], dia_data["N"])
        if distance(mp, dp) <= threshold:
            matched_pipes.append(pipe)
            matched_diams.append(float(dia_data["Dia"]))  # Extract as double
            messages.append("Pipe matched to Dia {}".format(dia_data["Dia"]))
            matched = True
            break

    if not matched:
        messages.append("No match for pipe at ({:.2f}, {:.2f})".format(mp[0], mp[1]))

OUT = matched_pipes, matched_diams, messages
# ----------------------------------------
code_block_23 = CodeBlock { 0; }
getItemAtIndex_5 = List.GetItemAtIndex(list=python_script, index=code_block_23)
code_block_24 = CodeBlock { 1; }
getItemAtIndex_6 = List.GetItemAtIndex(list=python_script, index=code_block_24)
boolean = BoolSelector(true)
resize_2 = Autodesk.Civil.DynamoNodes.Pipe.Resize(pipe=getItemAtIndex_5, innerDiameterOrWidth=getItemAtIndex_6, useClosestSize=boolean)
